# Grasshopper definition MELT Ground Water Model 05.gh (Grasshopper 0.9.76)
# plug-ins: HDTReference

# PARTICLE TRACKING
realflow_emitter_path = Panel("C:\Users\LE\realflow\scenes\MELT Aquifer 04\particles\Lower Aquifer")
frame = Panel("""0
20
40
60
80""")
# CONTAINER
container = Geometry(<brep referenced from the Rhino model>)
starting_with_particle_id = Slider(10000, range=0..10000)
frame_2 = Panel("""0
10
20
25
50
75
100
125
150
175
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""")
track_particles = Slider(400, range=0..600)
int = Integer(frame_2)
starting_with = Panel("16000")
expression = Expression(x=realflow_emitter_path, y=int, Expression="Format(\"{0}_{1:00000}.asc\",x,y)")
particle_files_to_load = Panel(expression)
curve_angle = Slider(3, range=1..15)
coords = ImportCoordinates(
    File=expression,
    Separator=" ",
    Comment=curve_angle,
    XIndex=Slider(1, range=1..3),
    YIndex=Slider(3, range=1..3),
    ZIndex=Slider(2, range=1..3))
tstat = TreeStatistics(Tree=coords)  # -> Paths, Length, Count
particles_per_frame = Panel(tstat.Length)
subtraction = Subtraction(A=particles_per_frame, B=track_particles)
particles_per_frame_2 = Panel(subtraction)
viewer = ParamViewer(tstat.Length)
track_particles_2 = Panel(track_particles)
starting_with_2 = Panel(starting_with)
branch = TreeBranch(Tree=coords, Path=tstat.Paths, MaintainPaths=True)
subtraction_2 = Subtraction(A=tstat.Length, B=starting_with_2)
subtraction_3 = Subtraction(A=subtraction_2, B=track_particles_2)
addition = Addition(A=track_particles_2, B=starting_with_2)
subtraction_4 = Subtraction(A=0, B=starting_with_2)
shift = ShiftList(List=branch, Shift=subtraction_3, Wrap=False)
addition_2 = Addition(B=5)
prune = PruneTree(Tree=shift, Minimum=addition, Maximum=addition)  # -> simplify(Tree)
shift_2 = ShiftList(List=prune, Shift=subtraction_4, Wrap=False)  # -> simplify(List)
viewer_2 = ParamViewer(shift_2)
pshift = ShiftPaths(Data=shift_2, Offset=-1)
flip = FlipMatrix(Data=pshift)
number_slider = Slider(1, range=0..10)
rad = Radians(Degrees=Slider(38, range=0..180))
pt = Point(pshift)
pline = PolyLine(Vertices=flip, Closed=False)
# PATH LENGTH
len = Length(Curve=pline)
sort = SortList(Keys=flatten(len))  # -> Keys, ValuesA
item = ListItem(List=reverse(sort.Keys), Index=0, Wrap=True)
item_2 = ListItem(List=sort.Keys, Index=0, Wrap=True)
intcrv = Interpolate(Vertices=flip, Degree=3, Periodic=False, KnotStyle=1)  # -> Curve, Length, Domain
nurbs = NurbsCurve(Vertices=flip, Degree=3, Periodic=False)  # -> Curve, Length, Domain
kinkcrv = KinkyCurve(Vertices=flip, Degree=3, Angle=rad)  # -> Curve, Length, Domain
col = Colour(RGB(230, 55, 189))
col_2 = Colour(RGB(35, 73, 186))
gradient = Gradient(
    LowerLimit=item_2,
    UpperLimit=item,
    Parameter=len,
    stops=[0: RGB(47, 79, 79), 0.161: RGB(0, 128, 128), 0.44: RGB(46, 139, 87), 0.842: RGB(50, 205, 50)])
grad = Colour(gradient)
panel = Panel(item)
panel_2 = Panel(item_2)
previewlw = CustomPreviewLineweights(Geometry=pline, Shader=grad, Thickness=number_slider)
# POLYLINE
# INTERPOLATED CURVE
previewlw_2 = CustomPreviewLineweights(Geometry=intcrv.Curve, Shader=grad, Thickness=number_slider)
# NURBS CURVE
previewlw_3 = CustomPreviewLineweights(Geometry=nurbs.Curve, Shader=grad, Thickness=number_slider)
# POINTS ON PATH
preview = CustomPreview(Geometry=pt, Shader=col)
# KINKY CURVE
previewlw_4 = CustomPreviewLineweights(Geometry=kinkcrv.Curve, Shader=grad, Thickness=number_slider)
trim = TrimWithBrep(Curve=nurbs.Curve, Brep=<geometry referenced from the Rhino model>)  # -> Inside, Outside
createatts = CreateAttributes(Color=grad, enableFullPath=False)
previewlw_5 = CustomPreviewLineweights(Geometry=trim.Inside, Shader=grad, Thickness=number_slider)
bake = BakeGeometry(Bake=Toggle(False), Geometry=trim.Inside, Attributes=createatts)

# ----
# PARTICLE INPUT
number_slider_2 = Slider(0.25, range=0..0.5)
cone_line = Geometry(<curve referenced from the Rhino model>)
len_2 = Length(Curve=cone_line)  # -> expr("x+.2", Length)
cone = Cone(Base=Plane(origin=(0, 3, 4.5), x=(0, 1, 0), y=(1, 0, 0)), Radius=number_slider_2, Length=len_2)  # -> Cone, Tip

# ----
# WELL
number_slider_3 = Slider(0.075, range=0..0.5)
well_line = Geometry(<curve referenced from the Rhino model>)
pipe = Pipe(Curve=well_line, Radius=number_slider_3, Caps=0)
closed = Pipe(Curve=well_line, Radius=number_slider_3, Caps=1)

# ----
# AQUIFER PATH
number_slider_4 = Slider(0.1, range=0..0.5)
fracture_line = Geometry(<curve referenced from the Rhino model>)
pipe_2 = Pipe(Curve=fracture_line, Radius=number_slider_4, Caps=0)
closed_2 = Pipe(Curve=fracture_line, Radius=number_slider_4, Caps=1)

# ----
# FRACKING WELL
number_slider_5 = Slider(0.1, range=0..0.5)
well_line_2 = Geometry(<curve referenced from the Rhino model>)
pipe_3 = Pipe(Curve=well_line_2, Radius=number_slider_5, Caps=0)
closed_3 = Pipe(Curve=well_line_2, Radius=number_slider_5, Caps=1)

# ----
# UPPER AQUIFER
number_slider_6 = Slider(0.3, range=0..0.5)
aquifer_line = Geometry(<curve referenced from the Rhino model>)
pipe_4 = Pipe(Curve=aquifer_line, Radius=number_slider_6, Caps=0)
closed_4 = Pipe(Curve=aquifer_line, Radius=number_slider_6, Caps=1)

# ----
# LOWER AQUIFER
number_slider_7 = Slider(0.3, range=0..0.5)
aquifer_line_2 = Geometry(<curve referenced from the Rhino model>)
pipe_5 = Pipe(Curve=aquifer_line_2, Radius=number_slider_7, Caps=0)
closed_5 = Pipe(Curve=aquifer_line_2, Radius=number_slider_7, Caps=1)

join = BrepJoin(Breps=[closed_4, closed_2, closed_5, closed_3, closed])  # -> Breps, Closed

trim_2 = TrimSolid(Shape=pipe, Cutters=join.Breps)
well = Geometry(trim_2)

trim_3 = TrimSolid(Shape=cone.Cone, Cutters=join.Breps)
cone_2 = Geometry(trim_3)

trim_4 = TrimSolid(Shape=pipe_5, Cutters=join.Breps)
lower_aquifer = Geometry(trim_4)

trim_5 = TrimSolid(Shape=pipe_4, Cutters=join.Breps)
upper_aquifer = Geometry(trim_5)

trim_6 = TrimSolid(Shape=pipe_2, Cutters=join.Breps)
fracture = Geometry(trim_6)

trim_7 = TrimSolid(Shape=pipe_3, Cutters=join.Breps)
fracking_well = Geometry(trim_7)

# ----
# COMBINED
join_2 = BrepJoin(Breps=[trim_6, trim_5, trim_4, trim_2, trim_7, trim_3])  # -> Breps, Closed
tri = Triangulate(Mesh=join_2.Breps)  # -> Mesh, Count
combined = Geometry(tri.Mesh)

geo = Geometry(combined)
col_3 = Colour(RGB(145, 88, 219))
createatts_2 = CreateAttributes(LayerName="grasshopper", Color=col_3, enableFullPath=False)
bake_2 = BakeGeometry(Bake=Toggle(False), Geometry=geo, Attributes=createatts_2)
combined_2 = CustomPreview(Geometry=geo, Shader=col_3)

geo_2 = Geometry(cone_2)
col_4 = Colour(RGB(88, 219, 90))
createatts_3 = CreateAttributes(LayerName="grasshopper", Color=col_4, enableFullPath=False)
bake_3 = BakeGeometry(Bake=Toggle(False), Geometry=geo_2, Attributes=createatts_3)
preview_2 = CustomPreview(Geometry=geo_2, Shader=col_4)
