# Grasshopper definition MELT Ground Water Emitter 09.gh (Grasshopper 0.9.76)
# plug-ins: HDTReference

# ----
# PATH LENGTH
# POLYLINE
# NURBS CURVE
# KINKY CURVE
# POINTS ON PATH
realflow_emitter_path = Panel("C:\Users\LE\Documents\Work\DS18 Masterplan\Ground Water Sources 02\particles\Particles")
track_from_particle_id_0_to = Slider(40000, range=0..40000)
frame = Panel("""10
50""")
curve_angle = Slider(3, range=1..15)
int = Integer(frame)
expression = Expression(x=realflow_emitter_path, y=int, Expression="Format(\"{0}_{1:00000}.asc\",x,y)")
particle_files_to_load = Panel(expression)
panel = Panel("0")
coords = ImportCoordinates(
    File=["C:\Users\LE\realflow\scenes\LE 19 Erosion on Pyramids within Cylinder with Object Tracking\particles\Circle01_00046.asc", "C:\Users\LE\realflow\scenes\LE 19 Erosion on Pyramids within Cylinder with Object Tracking\particles\Circle01_00178.asc", "C:\Users\LE\realflow\scenes\LE 19 Erosion on Pyramids within Cylinder with Object Tracking\particles\Circle01_00330.asc", "C:\Users\LE\realflow\scenes\LE 19 Erosion on Pyramids within Cylinder with Object Tracking\particles\Circle01_00389.asc"],
    Separator=" ",
    Comment=curve_angle,
    XIndex=Slider(1, range=1..3),
    YIndex=Slider(2, range=1..3),
    ZIndex=Slider(3, range=1..3))
tstat = TreeStatistics(Tree=coords)  # -> Paths, Length, Count
particles_per_frame = Panel(tstat.Length)
pt = Point(coords)
lines = Panel(track_from_particle_id_0_to)
subtraction = Subtraction(A=tstat.Length, B=lines)
branch = TreeBranch(Tree=coords, Path=tstat.Paths, MaintainPaths=True)
shift = ShiftList(List=branch, Shift=subtraction, Wrap=False)
prune = PruneTree(Tree=shift, Minimum=1, Maximum=lines)  # -> simplify(Tree)
pshift = ShiftPaths(Data=prune, Offset=-1)
flip = FlipMatrix(Data=pshift)
number_slider = Slider(1, range=0..10)
rad = Radians(Degrees=Slider(38, range=0..180))
pt_2 = Point(pshift)
col = Colour(RGB(230, 55, 189))
pline = PolyLine(Vertices=flip, Closed=False)
len = Length(Curve=pline)
sort = SortList(Keys=flatten(len))  # -> Keys, ValuesA
item = ListItem(List=reverse(sort.Keys), Index=0, Wrap=True)
item_2 = ListItem(List=sort.Keys, Index=0, Wrap=True)
intcrv = Interpolate(Vertices=flip, Degree=3, Periodic=False, KnotStyle=1)  # -> Curve, Length, Domain
nurbs = NurbsCurve(Vertices=flip, Degree=3, Periodic=False)  # -> Curve, Length, Domain
kinkcrv = KinkyCurve(Vertices=flip, Degree=3, Angle=rad)  # -> Curve, Length, Domain
panel_2 = Panel(pt_2)
gradient = Gradient(
    LowerLimit=item_2,
    UpperLimit=item,
    Parameter=len,
    stops=[0: RGB(47, 79, 79), 0.161: RGB(0, 128, 128), 0.44: RGB(46, 139, 87), 0.842: RGB(50, 205, 50)])
grad = Colour(gradient)
col_2 = Colour(RGB(35, 73, 186))
panel_3 = Panel(item)
panel_4 = Panel(item_2)
previewlw = CustomPreviewLineweights(Geometry=pline, Shader=grad, Thickness=number_slider)
previewlw_2 = CustomPreviewLineweights(Geometry=intcrv.Curve, Shader=grad, Thickness=number_slider)
previewlw_3 = CustomPreviewLineweights(Geometry=nurbs.Curve, Shader=grad, Thickness=number_slider)
preview = CustomPreview(Geometry=pt_2, Shader=col)
previewlw_4 = CustomPreviewLineweights(Geometry=kinkcrv.Curve, Shader=grad, Thickness=number_slider)

# ----
# POLLUTED WELLS
# EXPORT TO REALFLOW
all_polluted_pts = Geometry([<brep referenced from the Rhino model> x3, <curve referenced from the Rhino model> x3])
area = Area(Geometry=all_polluted_pts)  # -> Area, Centroid
pt_3 = Point(area.Centroid)

# ----
# MOVE FROM POINT
one_polluted_pt = Geometry(<curve referenced from the Rhino model>)
area_2 = Area(Geometry=one_polluted_pt)  # -> Area, Centroid
pt_4 = Point(area_2.Centroid)

# ----
# SETTLEMENTS
geo = Geometry([<brep referenced from the Rhino model> x3])

# ----
# CONFIG
# IMPORT FROM REALFLOW
realflow_emitter_path_2 = Panel("C:\Users\LE\realflow\scenes\MELT Ground Water 06\particles\particles")
frame_2 = Panel("""50
100""")

frame_number = Slider(10, range=0..200)

# ----
# MOVEMENT VECTOR
origin_pt = Point(Point(0, 0, 0))
dist = Distance(PointA=pt_4, PointB=origin_pt)
panel_5 = Panel(dist)
neg = Negative(Value=panel_5)
moveaway = MoveAwayFrom(Geometry=pt_4, Emitter=origin_pt, Distance=neg)  # -> Geometry, Transform
vec = Vector(moveaway.Geometry)

list = ValueList({"10", "35", "60", "85", "110", "135", "160", "185"}, selected="135")

# ----
# LOAD ASC FILE
int_2 = Integer(list)
expression_2 = Expression(x=realflow_emitter_path_2, y=int_2, Expression="Format(\"{0}_{1:00000}.asc\",x,y)")
list_2 = ValueList({"0", "1", "2", "3"}, selected="1")
list_3 = ValueList({"0", "1", "2", "3"}, selected="3")
list_4 = ValueList({"0", "1", "2", "3"}, selected="2")
coords_2 = ImportCoordinates(File=expression_2, Separator=" ", Comment="5", XIndex=list_2, YIndex=list_3, ZIndex=list_4)
list_5 = ValueList({"0", "1", "2", "3", "4", "5", "6", "7", "8", "9"}, selected="5")
shift_2 = ShiftList(List=coords_2, Shift=list_5, Wrap=False)
pt_5 = Point(shift_2)

# ----
# MOVE TO ORIGIN
move = Move(Geometry=pt_3, Motion=vec)  # -> Geometry, Transform
pt_6 = Point(move.Geometry)

# ----
# MOVE TO ORIGIN
move_2 = Move(Geometry=geo, Motion=vec)  # -> Geometry, Transform

# ----
# RANDOM REDUCE
lng = ListLength(List=pt_5)
subtraction_2 = Subtraction(A=lng, B="100")
reduce = RandomReduce(Reduction=subtraction_2, Seed=1)
pt_7 = Point(reduce)

panel_6 = Panel(lng)

# ----
# EMITTER LINE
move_3 = Move(Geometry=pt_6, Motion=Vector(0, 0, -1000000))  # -> Geometry, Transform
ln = Line(StartPoint=pt_6, EndPoint=move_3.Geometry)

# ----
# SCALE DOWN
number_slider_2 = Slider(1e-06, range=0..1)
scale = Scale(Geometry=ln, Center=Point(0, 0, 0), Factor=number_slider_2)  # -> Geometry, Transform
geo_2 = Geometry(scale.Geometry)

# ----
# SCALE UP
division = Division(A=1, B=number_slider_2)
scale_2 = Scale(Geometry=pt_5, Center=Point(0, 0, 0), Factor=division)  # -> Geometry, Transform
geo_3 = Geometry(scale_2.Geometry)

# ----
# SCALE DOWN
scale_3 = Scale(Geometry=move_2.Geometry, Center=Point(0, 0, 0), Factor=number_slider_2)  # -> Geometry, Transform
geo_4 = Geometry(scale_3.Geometry)

# ----
# MOVE TO REALWORLD
rev = Reverse(Vector=vec)
move_4 = Move(Geometry=geo_3, Motion=rev)  # -> Geometry, Transform
pt_8 = Point(move_4.Geometry)

# ----
# MESH EMITTER
number_slider_3 = Slider(0.1, range=0.1..10)
pipe = Pipe(Curve=geo_2, Radius=number_slider_3, Caps=1)
tri = Triangulate(Mesh=pipe)  # -> Mesh, Count

tri_2 = Triangulate(Mesh=geo_4)  # -> Mesh, Count

# ----
# FLATTEN POINTS
pdecon = Deconstruct(Point=pt_8)  # -> XComponent, YComponent, ZComponent
pt_9 = ConstructPoint(XCoordinate=pdecon.XComponent, YCoordinate=pdecon.YComponent, ZCoordinate=0)

# ----
# CULL OUTSIDE
pt_10 = Point(pt_9)
outline = Geometry(<curve referenced from the Rhino model>)
incurve = PointInCurve(Point=pt_10, Curve=outline)  # -> Relationship, Point
cull = CullPattern(List=pt_10, CullPattern=incurve.Relationship)

# ----
# TO SPHERES
sph = Sphere(Base=PlaneXY(0, 0, 0), Radius=1)

# ----
# OUTPUT
toggle = BooleanToggle(False)
geo_5 = Geometry(tri.Mesh)
col_3 = Colour(RGB(53, 119, 212))
createatts = CreateAttributes(LayerName="realflow", Color=col_3, enableFullPath=False)
bake = BakeGeometry(Bake=toggle, Geometry=geo_5, Attributes=createatts)
preview_2 = CustomPreview(Geometry=geo_5, Shader=col_3)

# ----
# OUTPUT
toggle_2 = BooleanToggle(False)
geo_6 = Geometry(tri_2.Mesh)
col_4 = Colour(RGB(53, 119, 212))
createatts_2 = CreateAttributes(LayerName="realflow", Color=col_4, enableFullPath=False)
bake_2 = BakeGeometry(Bake=toggle_2, Geometry=geo_6, Attributes=createatts_2)
preview_3 = CustomPreview(Geometry=geo_6, Shader=col_4)

# ----
# OUTPUT
toggle_3 = BooleanToggle(False)
geo_7 = Geometry(cull)
col_5 = Colour(RGB(103, 212, 53))
createatts_3 = CreateAttributes(LayerName="particles", Color=col_5, enableFullPath=False)
bake_3 = BakeGeometry(Bake=toggle_3, Geometry=geo_7, Attributes=createatts_3)
preview_4 = CustomPreview(Geometry=geo_7, Shader=col_5)
